# Grasshopper definition Timber-preview.ghx (Grasshopper 1.0.8)
# plug-ins: Woodie

# ---- group: 01 / Cutting
# 01 / CUT THROUGH THE STOCK
# Move Position and Angle to expose the interior. Keep Positive reverses the retained side.
# The original stock fixes the knot field; Cut outputs document units. Preview uses Document.
# Right-click Preview > Bake for native textured geometry. Save textures in the 3dm.
# Cut controls
# Retain side
# Construct the plane
# 1200 × 300 × 120 mm
# Appearance
original_stock_mm = Geometry(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)
# WOODIE / TIMBER PLAYGROUND
# 01 Cut through the stock     02 Follow a knot     03 Build your own stack     04 Product library     05 Rotated tower     06 Natural bamboo
# Start with the demonstrations below. Open a material's arrow for its controls.
# Units are handled by the definition · 1 mm/pixel · input geometry stays unchanged.
# Procedural appearance inspired by Larsson et al. (2022), DOI 10.1145/3528223.3530081.
position = Slider(50, range=0..100)
angle_degrees = Slider(0, range=-75..75)
multiplication = Multiplication(A=position, B=12)
pt = ConstructPoint(XCoordinate=multiplication, YCoordinate=150, ZCoordinate=60)
rad = Radians(Degrees=angle_degrees)
cos = Cosine(Value=rad)
sin = Sine(Value=rad)
vec = VectorXYZ(XComponent=cos, YComponent=0, ZComponent=sin)  # -> Vector, Length
pl = PlaneNormal(Origin=pt, ZAxis=vec.Vector)
cutting_material = TimberMaterial(Seed=3, Resolution=1, Advanced=False, PanelExpanded=False, SelectedLook=0, SelectedProduct=5, WoodieMaterialVersion=3)  # -> Settings, Product
keep_positive = BooleanToggle(False)
timbercut = TimberCut(Geometry=original_stock_mm, CuttingPlane=pl, KeepPositive=keep_positive, GeometryUnits="Millimetres")  # -> Geometry, StockGeometry, SectionOutlines, StockModel
cutting_plane_outline = Curve(timbercut.SectionOutlines)
cutting_preview = TimberPreview(
    Geometry=timbercut.Geometry,
    Settings=cutting_material.Settings,
    BasePlane=PlaneXY(0, 0, 0),
    Show=True,
    StockGeometry=timbercut.StockGeometry,
    PreviewDisplayMode=0,
    ShowKnotInfluence=False)  # -> Meshes, Products, AlignedBox, Frame

# ---- group: 02 / Knot cutaway
# 02 / FOLLOW A KNOT
# One connected piece; terraces at 120 / 80 / 40 mm.
# Move Knot section to expose a capped cross-section.
# Automatic seed 3; the uncut stepped stock fixes the grain.
# Stepped solid / mm
# Natural / seed 3
uncut_stepped_stock_mm = Geometry(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)
knot_section = Slider(70, range=0..100)
multiplication_2 = Multiplication(A=knot_section, B=12)
pt_2 = ConstructPoint(XCoordinate=multiplication_2, YCoordinate=800, ZCoordinate=60)
pl_2 = PlaneNormal(Origin=pt_2, ZAxis=Vector(1, 0, 0))
knot_section_2 = TimberCut(Geometry=uncut_stepped_stock_mm, CuttingPlane=pl_2, KeepPositive=False, GeometryUnits="Millimetres")  # -> Geometry, StockGeometry, SectionOutlines, StockModel
knot_section_outline = Curve(knot_section_2.SectionOutlines)
cutaway_material = TimberMaterial(Seed=3, Resolution=1, Advanced=False, PanelExpanded=False, SelectedLook=0, SelectedProduct=5, WoodieMaterialVersion=3)  # -> Settings, Product
cutaway_preview = TimberPreview(
    Geometry=knot_section_2.Geometry,
    Settings=cutaway_material.Settings,
    BasePlane=PlaneXY(0, 0, 0),
    Show=True,
    StockGeometry=knot_section_2.StockGeometry,
    PreviewDisplayMode=0,
    ShowKnotInfluence=False)  # -> Meshes, Products, AlignedBox, Frame

# ---- group: 05 / Same log tower
# 05 / SAME LOG → TOWER
# One seed-3 log is cut into 16 blanks. Each blank keeps that cut as Stock Geometry so grain differs.
# Lines map blank end to tower foot. Fibre and plane stay along each blank so cylinder ends do not remap the log field.
# Blanks and tower start Textured. Right-click for Gradient or Force flow. The knot-influence disk uses the same log-sized field.
# 16 blanks · 100 × 40 mm · seed 3 · 1 mm/pixel · per-cut Stock Geometry
blankfibre = BlankFibre([Vector(1, 0, 0), Vector(1, 0, 0), Vector(1, 0, 0), Vector(1, 0, 0), Vector(1, 0, 0), Vector(1, 0, 0), Vector(1, 0, 0), Vector(1, 0, 0), Vector(1, 0, 0), Vector(1, 0, 0), Vector(1, 0, 0), Vector(1, 0, 0), Vector(1, 0, 0), Vector(1, 0, 0), Vector(1, 0, 0), Vector(1, 0, 0)])
blankplane = BlankPlane([PlaneXY(1980, 2597.5, 199), PlaneXY(1980, 2732.5, 199), PlaneXY(1980, 2867.5, 199), PlaneXY(1980, 3002.5, 199), PlaneXY(1980, 2597.5, 253), PlaneXY(1980, 2732.5, 253), PlaneXY(1980, 2867.5, 253), PlaneXY(1980, 3002.5, 253), PlaneXY(1980, 2597.5, 307), PlaneXY(1980, 2732.5, 307), PlaneXY(1980, 2867.5, 307), PlaneXY(1980, 3002.5, 307), PlaneXY(1980, 2597.5, 361), PlaneXY(1980, 2732.5, 361), PlaneXY(1980, 2867.5, 361), PlaneXY(1980, 3002.5, 361)])
blanks = LogBlanksMm([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])
blankstock = LogStockPerBlankMm([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])
slatfibre = SlatFibre([Vector(-0.2021378947, 0.2519529598, 0.9463931411), Vector(-0.2831692871, 0.1554193593, 0.9463931411), Vector(-0.3210907225, 0.0352245703, 0.9463931411), Vector(-0.3101290061, -0.09033284025, 0.9463931411), Vector(-0.2519529598, -0.2021378947, 0.9463931411), Vector(-0.1554193593, -0.2831692871, 0.9463931411)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])
slatplane = SlatPlane([Plane(origin=(586.4123418, 3066.224414, 1000), x=(-0.2021378947, 0.2519529598, 0.9463931411), y=(0.5922347132, -0.7381856285, 0.3230170621)), Plane(origin=(439.8946875, 3270.369575, 1000), x=(-0.2831692871, 0.1554193593, 0.9463931411), y=(0.82964494, -0.4553561806, 0.3230170621)), Plane(origin=(226.4070547, 3402.905232, 1000), x=(-0.3210907225, 0.0352245703, 0.9463931411), y=(0.9407492454, -0.1032028819, 0.3230170621)), Plane(origin=(-21.54899977, 3443.654033, 1000), x=(-0.3101290061, -0.09033284025, 0.9463931411), y=(0.9086330061, 0.2646621199, 0.3230170621)), Plane(origin=(-266.2244144, 3386.412342, 1000), x=(-0.2519529598, -0.2021378947, 0.9463931411), y=(0.7381856285, 0.5922347132, 0.3230170621)), Plane(origin=(-470.3695753, 3239.894688, 1000), x=(-0.1554193593, -0.2831692871, 0.9463931411), y=(0.4553561806, 0.82964494, 0.3230170621))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])
slats = TowerSlatsMm([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])
slatstock = LogStockPerSlatMm([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])
placement_lines = Curve([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])
log_envelope = Curve(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)
knot_influence = Mesh(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)
tower_material = TimberMaterial(Seed=3, Resolution=1, Advanced=False, PanelExpanded=False, SelectedLook=0, SelectedProduct=5, WoodieMaterialVersion=3)  # -> Settings, Product
log_blanks_preview = TimberPreview(
    Geometry=blanks,
    Settings=tower_material.Settings,
    Fibre=blankfibre,
    BasePlane=blankplane,
    Show=True,
    GeometryUnits="Millimetres",
    StockGeometry=blankstock,
    PreviewDisplayMode=0,
    ShowKnotInfluence=False)  # -> Meshes, Products, AlignedBox, Frame
tower_preview = TimberPreview(
    Geometry=slats,
    Settings=tower_material.Settings,
    Fibre=slatfibre,
    BasePlane=slatplane,
    Show=True,
    GeometryUnits="Millimetres",
    StockGeometry=slatstock,
    PreviewDisplayMode=0,
    ShowKnotInfluence=False)  # -> Meshes, Products, AlignedBox, Frame

# ---- group: 06 / Natural bamboo
# 06 / NATURAL BAMBOO
# Bamboo Stock builds a hollow Moso culm (Ø 80 · wall 7 · 1500 mm) on the demo ground line.
# A vertical half-cut shows wall, cavity and nodes with cured bamboo texture.
culm_section_plane = Plane(PlaneYZ(1600, 150, 750))
culm_material = TimberMaterial(Seed=3, Resolution=8, Advanced=False, PanelExpanded=False, SelectedLook=0, SelectedProduct=5, WoodieMaterialVersion=3)  # -> Settings, Product
bamboo_culm = BambooStock(
    Line=Line((1600, 150, 0), (1600, 150, 1500)),
    Settings=culm_material.Settings,
    GeometryUnits="Millimetres",
    Advanced=True,
    PanelExpanded=True,
    SelectedSpecies=0,
    WoodieBambooVersion=3)  # -> StockModel, Geometry
culm_geometry = Geometry(bamboo_culm.Geometry)
culm_vertical_section = TimberCut(CuttingPlane=culm_section_plane, KeepPositive=False, GeometryUnits="Millimetres", StockModel=bamboo_culm.StockModel)  # -> Geometry, StockGeometry, SectionOutlines, StockModel
culm_section_outline = Curve(culm_vertical_section.SectionOutlines)
bamboo_culm_section_preview = TimberPreview(Show=True, StockModel=culm_vertical_section.StockModel, PreviewDisplayMode=0, ShowKnotInfluence=False)  # -> Meshes, Products, AlignedBox, Frame

# ---- group: 03 / Custom buildup
# 03 / BUILD YOUR OWN STACK
# Layer → Buildup → Preview. Stack order is bottom to top.
# Exact 30 / 60 cross / 30 mm; enable Fit only to scale proportions.
# Appearance
# Bottom / 30 mm
# Cross core / 60 mm
# Top / 30 mm
# 120 mm stock / mm
# Resolved schedule
# Section diagram output
# Preview hidden; isolate it for inspection.
stock = CustomBuildupStock(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)
buildup_material = TimberMaterial(Seed=0, Resolution=1, Advanced=False, PanelExpanded=False, SelectedLook=1, SelectedProduct=0, WoodieMaterialVersion=3)  # -> Settings, Product
timberlayer = TimberLayer(Thickness=30, Direction=0, Construction=1, BoardWidth=150, EndJoints=0)  # -> Layer, Description
timberlayer_2 = TimberLayer(Thickness=60, Direction=1, Construction=1, BoardWidth=150, EndJoints=0)  # -> Layer, Description
timberlayer_3 = TimberLayer(Thickness=30, Direction=0, Construction=1, BoardWidth=150, EndJoints=0)  # -> Layer, Description
timberbuildup = TimberBuildup(
    Settings=buildup_material.Settings,
    Layers=[timberlayer.Layer, timberlayer_2.Layer, timberlayer_3.Layer],
    FitToPart=False)  # -> Settings, Layers, Thickness, Schedule, SectionDiagram
section_diagram = Curve(timberbuildup.SectionDiagram)
custom_buildup = TimberPreview(
    Geometry=stock,
    Settings=timberbuildup.Settings,
    BasePlane=PlaneXY(0, 0, 0),
    Show=True,
    GeometryUnits="Millimetres",
    PreviewDisplayMode=0,
    ShowKnotInfluence=False)  # -> Meshes, Products, AlignedBox, Frame
layer_schedule = Panel(timberbuildup.Schedule)

# ---- group: 04 / Product library
# 04 / PRODUCT LIBRARY
# Eleven geometry cases on one Material. Change Product on Timber Material to switch appearance.
# Show starts off. Shared Settings / Show / Units wires appear when selected.
# All engineered products
# Start as Solid timber · 120 mm · Clean/Pale · 1 mm/pixel · switch Product on Material
# Material
# Source coordinates
# 01 Solid Brep
# 02 Extrusion
# 03 Surface
# 04 Closed mesh
# 05 Open mesh
# 06 Trimmed + hole
# 07 Bowed surface
# 08 Bowed Brep
# 09 Guided solid
# 10 Guided extrusion
# 11 Guided mesh
millimetres = SourceCoordinateUnits("Millimetres")
geometry = SolidTimber01FlatSolidBrepMatchedLength(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)
geometry_2 = SolidTimber02Extrusion(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)
geometry_3 = SolidTimber03FlatSurface(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)
geometry_4 = SolidTimber04ClosedMesh(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)
geometry_5 = SolidTimber05OpenMesh(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)
geometry_6 = SolidTimber06TrimmedSurfaceWithHole(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)
geometry_7 = SolidTimber07BowedSurfaceAutomatic(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)
geometry_8 = SolidTimber08BowedSingleFaceBrepAutomatic(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)
geometry_9 = SolidTimber09BowedSolidBrepGuide(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)
guide = SolidTimber09BowedSolidBrepGuideGuide(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)
geometry_10 = SolidTimber10BowedExtrusionGuide(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)
guide_2 = SolidTimber10BowedExtrusionGuideGuide(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)
geometry_11 = SolidTimber11BowedMeshGuide(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)
guide_3 = SolidTimber11BowedMeshGuideGuide(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)
library_preview = TimberMaterial(Seed=0, Resolution=1, Advanced=False, PanelExpanded=False, SelectedLook=1, SelectedProduct=5, WoodieMaterialVersion=3)  # -> Settings, Product
show_library = BooleanToggle(False)
solid_timber_01_flat_solid_brep_matched = TimberPreview(
    Geometry=geometry,
    Settings=library_preview.Settings,
    Show=show_library,
    GeometryUnits=millimetres,
    PreviewDisplayMode=0,
    ShowKnotInfluence=False)  # -> Meshes, Products, AlignedBox, Frame; "Solid timber / 01 Flat solid Brep (matched length)"
solid_timber_02_extrusion = TimberPreview(
    Geometry=geometry_2,
    Settings=library_preview.Settings,
    Show=show_library,
    GeometryUnits=millimetres,
    PreviewDisplayMode=0,
    ShowKnotInfluence=False)  # -> Meshes, Products, AlignedBox, Frame
solid_timber_03_flat_surface = TimberPreview(
    Geometry=geometry_3,
    Settings=library_preview.Settings,
    Show=show_library,
    GeometryUnits=millimetres,
    PreviewDisplayMode=0,
    ShowKnotInfluence=False)  # -> Meshes, Products, AlignedBox, Frame
solid_timber_04_closed_mesh = TimberPreview(
    Geometry=geometry_4,
    Settings=library_preview.Settings,
    Show=show_library,
    GeometryUnits=millimetres,
    PreviewDisplayMode=0,
    ShowKnotInfluence=False)  # -> Meshes, Products, AlignedBox, Frame
solid_timber_05_open_mesh = TimberPreview(
    Geometry=geometry_5,
    Settings=library_preview.Settings,
    Show=show_library,
    GeometryUnits=millimetres,
    PreviewDisplayMode=0,
    ShowKnotInfluence=False)  # -> Meshes, Products, AlignedBox, Frame
solid_timber_06_trimmed_surface_with_hol = TimberPreview(
    Geometry=geometry_6,
    Settings=library_preview.Settings,
    Show=show_library,
    GeometryUnits=millimetres,
    PreviewDisplayMode=0,
    ShowKnotInfluence=False)  # -> Meshes, Products, AlignedBox, Frame; "Solid timber / 06 Trimmed surface with hole"
solid_timber_07_bowed_surface_automatic = TimberPreview(
    Geometry=geometry_7,
    Settings=library_preview.Settings,
    Show=show_library,
    GeometryUnits=millimetres,
    PreviewDisplayMode=0,
    ShowKnotInfluence=False)  # -> Meshes, Products, AlignedBox, Frame
solid_timber_08_bowed_single_face_brep_a = TimberPreview(
    Geometry=geometry_8,
    Settings=library_preview.Settings,
    Show=show_library,
    GeometryUnits=millimetres,
    PreviewDisplayMode=0,
    ShowKnotInfluence=False)  # -> Meshes, Products, AlignedBox, Frame; "Solid timber / 08 Bowed single-face Brep - automatic"
solid_timber_09_bowed_solid_brep_guide = TimberPreview(
    Geometry=geometry_9,
    Settings=library_preview.Settings,
    BasePlane=PlaneXY(0, 0, 0),
    GuideCurve=guide,
    Show=show_library,
    GeometryUnits=millimetres,
    PreviewDisplayMode=0,
    ShowKnotInfluence=False)  # -> Meshes, Products, AlignedBox, Frame
solid_timber_10_bowed_extrusion_guide = TimberPreview(
    Geometry=geometry_10,
    Settings=library_preview.Settings,
    BasePlane=PlaneXY(0, 0, 0),
    GuideCurve=guide_2,
    Show=show_library,
    GeometryUnits=millimetres,
    PreviewDisplayMode=0,
    ShowKnotInfluence=False)  # -> Meshes, Products, AlignedBox, Frame
solid_timber_11_bowed_mesh_guide = TimberPreview(
    Geometry=geometry_11,
    Settings=library_preview.Settings,
    BasePlane=PlaneXY(0, 0, 0),
    GuideCurve=guide_3,
    Show=show_library,
    GeometryUnits=millimetres,
    PreviewDisplayMode=0,
    ShowKnotInfluence=False)  # -> Meshes, Products, AlignedBox, Frame
